% Simulink data dictionary MotorControl.sldd
% references ADCRawToIab.sldd

Tsec = Simulink.Signal(DataType="fixdt(0,32,2^-22,0)", Min=0, Max=500, Unit="sec", InitialValue="0")
Sig_dAxis_m = Simulink.Signal(StorageClass="ExportedGlobal")
Sig_qAxis_m = Simulink.Signal(StorageClass="ExportedGlobal")
Sig_theta_el_m = Simulink.Signal(StorageClass="ExportedGlobal")
Sig_Ia_m = Simulink.Signal(StorageClass="ExportedGlobal")
Sig_Ib_m = Simulink.Signal(StorageClass="ExportedGlobal")
Sig_dAxis_errorSum_m = Simulink.Signal(StorageClass="ExportedGlobal")
Sig_dAxis_PI_out = Simulink.Signal(StorageClass="ExportedGlobal")
Sig_qAxis_errorSum_m = Simulink.Signal(StorageClass="ExportedGlobal")
Sig_qAxis_PI_out = Simulink.Signal(StorageClass="ExportedGlobal")
Sig_Emfobs_errorSum_m = Simulink.Signal(StorageClass="ExportedGlobal")
Sig_Emfobs_PI_out = Simulink.Signal(StorageClass="ExportedGlobal")
Sig_Vdsatu_m = Simulink.Signal(StorageClass="ExportedGlobal")
Sig_Vqsatu_m = Simulink.Signal(StorageClass="ExportedGlobal")
Sig_Va_m = Simulink.Signal(StorageClass="ExportedGlobal")
Sig_Vb_m = Simulink.Signal(StorageClass="ExportedGlobal")
p = Simulink.Parameter(4, StorageClass="Const", HeaderFile="ConstParams.h", DefinitionFile="ConstParams.c", Owner="pmsm", PreserveDimensions=true, DataType="fixdt(1,32,2^-22,0)")  % fixdt(1,32,2^-22,0)
MaxBckEMFVol_sat = Simulink.Parameter(12, StorageClass="Const", HeaderFile="ConstParam.h", DefinitionFile="ConstParams.c", DataType="fixdt(1,8,2^-1,0)", Min=-50, Max=50, Unit="V")  % fixdt(1,8,2^-1,0)
Rs = Simulink.Parameter(0.022, StorageClass="Const", HeaderFile="ConstParams.h", DefinitionFile="ConstParams.c", Owner="pmsm", PreserveDimensions=true, DataType="fixdt(1,32,2^-22,0)")  % fixdt(1,32,2^-22,0)
psim = Simulink.Parameter(0.00375, StorageClass="Const", HeaderFile="ConstParams.h", DefinitionFile="ConstParams.c", Owner="pmsm", PreserveDimensions=true, DataType="fixdt(1,32,2^-22,0)")  % fixdt(1,32,2^-22,0)
Ld = Simulink.Parameter(1.93e-5, StorageClass="Const", HeaderFile="ConstParams.h", DefinitionFile="ConstParams.c", Owner="pmsm", PreserveDimensions=true, DataType="fixdt(1,32,2^-22,0)")  % fixdt(1,32,2^-22,0)
dSoll = Simulink.Parameter(0, StorageClass="Const", HeaderFile="ConstParams.h", DefinitionFile="ConstParams.c", DataType="int8")  % int8
Vnom = Simulink.Parameter(12, StorageClass="Const", HeaderFile="ConstParams.h", DefinitionFile="ConstParams.c", Owner="pmsm", PreserveDimensions=true, DataType="fixdt(1,32,2^-22,0)")  % fixdt(1,32,2^-22,0)
BrkPoints = Simulink.Parameter([-1 0 1], StorageClass="Const", HeaderFile="ConstParams.h", DefinitionFile="ConstParams.c", Owner="pmsm", DataType="fixdt(1,16,2^-8,0)")  % fixdt(1,16,2^-8,0)
PWM_A_DT = Simulink.Signal(StorageClass="GetSet", HeaderFile="InterfaceBswApp.h", GetFunction="get_$N", SetFunction="set_$N", DataType="uint16", InitialValue="0")
PWM_B_DT = Simulink.Signal(StorageClass="GetSet", HeaderFile="InterfaceBswApp.h", GetFunction="get_$N", SetFunction="set_$N", DataType="uint16", InitialValue="0")
PWM_C_DT = Simulink.Signal(StorageClass="GetSet", HeaderFile="InterfaceBswApp.h", GetFunction="get_$N", SetFunction="set_$N", DataType="uint16", InitialValue="0")
EMFobsRS = Simulink.Parameter(0.34, StorageClass="Const", HeaderFile="ConstParams.h", DefinitionFile="ConstParams.c", Owner="pmsm", DataType="fixdt(1,16,2^-8,0)")  % fixdt(1,16,2^-8,0)

VphMax = Simulink.Parameter(6.92, StorageClass="Const", HeaderFile="ConstParams.h", DataType="fixdt(1,16,2^-8,0)")  % fixdt(1,16,2^-8,0)
  % Val = Vnom*(1/sqrt(3))

TqToIqConst = Simulink.Parameter(97.75, StorageClass="Const", HeaderFile="ConstParams.h", DefinitionFile="ConstParams.c", Owner="pmsm", DataType="fixdt(1,16,2^-8,0)")  % fixdt(1,16,2^-8,0)
  % Val=2/(3*p*psim)=2/3*Kt
  % old=44.44

d_q_Voltage_Limiter_sat_pos = Simulink.Parameter(6, StorageClass="Const", HeaderFile="ConstParams.h", DefinitionFile="ConstParams.c", DataType="fixdt(1,16,2^-4,0)", Unit="V")  % fixdt(1,16,2^-4,0)
d_q_Voltage_Limiter_sat_neg = Simulink.Parameter(-6, StorageClass="Const", HeaderFile="ConstParams.h", DefinitionFile="ConstParams.c", DataType="fixdt(1,16,2^-4,0)", Unit="V")  % fixdt(1,16,2^-4,0)
CuttOffFreq_c = Simulink.Parameter(4000, StorageClass="ExportedGlobal", DataType="uint16")
Ts = Simulink.Parameter(5.0e-5, Unit="sec")
set_AngleInput = Simulink.Signal(StorageClass="ExportedGlobal", DataType="uint8")
enableFluxObs = Simulink.Signal(StorageClass="ExportedGlobal", DataType="boolean")
enablePositionObs = Simulink.Signal(StorageClass="ExportedGlobal", DataType="boolean")
PositionObsAnlge = Simulink.Signal(StorageClass="ExportedGlobal", DataType="fixdt(1,16,2^-8,0)")
TsIntern = Simulink.Parameter(5.0e-5, StorageClass="ExportedGlobal", DataType="fixdt(0,32,2^-24,0)", Unit="sec")  % fixdt(0,32,2^-24,0)
Kp_Iab_EMFobs = Simulink.Parameter(1, StorageClass="ExportedGlobal", DataType="fixdt(1,16,2^-8,0)")  % fixdt(1,16,2^-8,0)
Ki_Iab_EMFobs = Simulink.Parameter(0, StorageClass="ExportedGlobal", DataType="fixdt(1,16,2^-3,0)")  % fixdt(1,16,2^-3,0)
Ki_qAxis = Simulink.Parameter(0, StorageClass="ExportedGlobal", DataType="fixdt(1,16,2^-5,0)")  % fixdt(1,16,2^-5,0)
Kp_qAxis = Simulink.Parameter(1, StorageClass="ExportedGlobal", DataType="fixdt(1,16,2^-5,0)")  % fixdt(1,16,2^-5,0)
Ki_dAxis = Simulink.Parameter(0, StorageClass="ExportedGlobal", DataType="fixdt(1,16,2^-5,0)")  % fixdt(1,16,2^-5,0)
Kp_dAxis = Simulink.Parameter(1, StorageClass="ExportedGlobal", DataType="fixdt(1,16,2^-5,0)")  % fixdt(1,16,2^-5,0)
resetPIIntegrator = Simulink.Signal(StorageClass="ExportedGlobal", DataType="boolean", InitialValue="0")
qSoll = Simulink.Parameter(0, StorageClass="ExportedGlobal", DataType="fixdt(1,8,2^-7,0)", Unit="Nm")  % fixdt(1,8,2^-7,0)
dth_dt = Simulink.Signal(StorageClass="ExportedGlobal", DataType="int16", InitialValue="210")
FluxObsAngle = Simulink.Signal(StorageClass="ExportedGlobal", DataType="fixdt(1,16,2^-8,0)")
Sig_Ibeta_m = Simulink.Signal(StorageClass="ExportedGlobal")
constantAngle = Simulink.Signal(StorageClass="ExportedGlobal")

EMFobsLdGain = Simulink.Parameter(50000, StorageClass="Const", HeaderFile="ConstParams.h", DefinitionFile="ConstParams.c", DataType="fixdt(0,16,2^2,0)")  % (1/L) = 100.000
  % fixdt(1,16,2^2,0)

MaxBckEMFVol_sat_neg = Simulink.Parameter(-12, StorageClass="ExportedGlobal", DataType="fixdt(1,16,2^-2,0)", Min=-100, Max=100, Unit="V")  % fixdt(1,16,2^-2,0)
MaxBckEMFVol_sat_pos = Simulink.Parameter(12, StorageClass="ExportedGlobal", DataType="fixdt(1,16,2^-2,0)", Min=-100, Max=100, Unit="V")  % fixdt(1,32,2^-8,0)